# Grasshopper definition test_gh_to_dat.gh (Grasshopper 0.9.76)
# plug-ins: gh_to_dat

id = Slider(1, range=1..20)
group_number = Slider(1, range=1..20)
section_number = Slider(1, range=1..20)
some_curves = Curve(<curve referenced from the Rhino model>)
other_curves = Curve([<curve referenced from the Rhino model> x2])
sln = SLN(Curve=other_curves, Id=id, Group=group_number, Section=section_number, LocalZ=Vector(0, 0, 0))
end = EndPoints(Curve=other_curves)  # -> Start, End
merge = Merge(Data1=end.Start, Data2=end.End)
spt = SPT(Point=merge, Id=0, LocalX=Vector(0, 0, 0), LocalZ=Vector(0, 0, 0), Fix="PP")
panel = Panel("""PROG AQUA
HEAD
NORM DIN EN1992-2004
STEE 1 S 235

PROF 1 IPE 300 mno 1
PROF 2 IPE 400 mno 1
END""")
panel_2 = Panel("""SYST 3D GDIV -1000 NEGZ
CTRL MESH 1
CTRL HMIN 0.5""")
merge_2 = Merge(Data1=sln, Data2=spt)
sofimshc = SOFiMSHC(ControlValues=panel_2, Geometry=merge_2)
concat = Concatenate(FragmentA=panel, FragmentB=sofimshc)
panel_3 = Panel(concat)
